# Grasshopper definition app.gh (Grasshopper 1.0.7)
# plug-ins: Hops

number_slider = Slider(33, range=0..100)
# ListInput
panel = Panel("http://127.0.0.1:5000")
# Multifunction
panel_2 = Panel("http://127.0.0.1:5000")
concatenate = Concatenate(FragmentA="http://127.0.0.1:5000", FragmentB="/mycomponent")
concatenate_2 = Concatenate(FragmentA=panel, FragmentB="/listinput")
concatenate_3 = Concatenate(FragmentA="http://127.0.0.1:5000", FragmentB="/mycomponent")
concatenate_4 = Concatenate(FragmentA="http://127.0.0.1:5000", FragmentB="/listoutput")
concatenate_5 = Concatenate(FragmentA=panel_2, FragmentB="/addition")
concatenate_6 = Concatenate(FragmentA="http://127.0.0.1:5000", FragmentB="/substraction")
concatenate_7 = Concatenate(FragmentA="http://127.0.0.1:5000", FragmentB="/multiplication")
duplicate_data = DuplicateData(Data=Slider(1, range=0..1), Number=Slider(10, range=0..10), Order=True)
hops = Hops(
    Name="salvador",
    Age=number_slider,
    CacheResultsInMemory=True,
    CacheSolveResults=True,
    RemoteDefinitionLocation="http://127.0.0.1:5000/mycomponent",
    RemoteSolveVersion=(0, 1, 0),
    ShowInput_Enabled=False,
    ShowInput_Path=False,
    SynchronousSolve=True)
panel_3 = Panel(hops)
hops_2 = Hops(
    _Path=concatenate,
    Name="salvador",
    Age=number_slider,
    CacheResultsInMemory=True,
    CacheSolveResults=True,
    RemoteDefinitionLocation="http://127.0.0.1:5000/mycomponent",
    RemoteSolveVersion=(0, 1, 0),
    ShowInput_Enabled=False,
    ShowInput_Path=True,
    SynchronousSolve=True)
hops_3 = Hops(
    _Path=concatenate,
    Name="salvador",
    Age=30,
    CacheResultsInMemory=True,
    CacheSolveResults=True,
    RemoteDefinitionLocation="http://127.0.0.1:5000/mycomponent",
    RemoteSolveVersion=(0, 1, 0),
    ShowInput_Enabled=False,
    ShowInput_Path=True,
    SynchronousSolve=True)
hops_4 = Hops(
    _Path=concatenate_2,
    ListOfNumbers=duplicate_data,
    CacheResultsInMemory=True,
    CacheSolveResults=True,
    RemoteDefinitionLocation="http://127.0.0.1:5000/listinput",
    RemoteSolveVersion=(0, 1, 0),
    ShowInput_Enabled=False,
    ShowInput_Path=True,
    SynchronousSolve=True)
hops_5 = Hops(
    _Path=concatenate_4,
    TextToRepead="na",
    Repeat=Slider(100, range=0..100),
    CacheResultsInMemory=True,
    CacheSolveResults=True,
    RemoteDefinitionLocation="http://127.0.0.1:5000/listoutput",
    RemoteSolveVersion=(0, 1, 0),
    ShowInput_Enabled=False,
    ShowInput_Path=True,
    SynchronousSolve=True)
hops_6 = Hops(
    _Path=concatenate_7,
    FirstNumber=Slider(65, range=0..100),
    SecondNumber=Slider(59, range=0..100),
    CacheResultsInMemory=True,
    CacheSolveResults=True,
    RemoteDefinitionLocation="http://127.0.0.1:5000/multiplication",
    RemoteSolveVersion=(0, 1, 0),
    ShowInput_Enabled=False,
    ShowInput_Path=True,
    SynchronousSolve=True)
hops_7 = Hops(
    _Path=concatenate_5,
    FirstNumber=Slider(65, range=0..100),
    SecondNumber=Slider(59, range=0..100),
    CacheResultsInMemory=True,
    CacheSolveResults=True,
    RemoteDefinitionLocation="http://127.0.0.1:5000/addition",
    RemoteSolveVersion=(0, 1, 0),
    ShowInput_Enabled=False,
    ShowInput_Path=True,
    SynchronousSolve=True)
hops_8 = Hops(
    _Path=concatenate_6,
    FirstNumber=Slider(65, range=0..100),
    SecondNumber=Slider(59, range=0..100),
    CacheResultsInMemory=True,
    CacheSolveResults=True,
    RemoteDefinitionLocation="http://127.0.0.1:5000/substraction",
    RemoteSolveVersion=(0, 1, 0),
    ShowInput_Enabled=False,
    ShowInput_Path=True,
    SynchronousSolve=True)
hops_9 = Hops(
    _Path=concatenate_3,
    FirstNumber=Slider(46, range=0..100),
    SecondNumber=Slider(63, range=0..100),
    CacheResultsInMemory=True,
    CacheSolveResults=True,
    RemoteDefinitionLocation="http://127.0.0.1:5000/mycomponent",
    RemoteSolveVersion=(0, 1, 0),
    ShowInput_Enabled=False,
    ShowInput_Path=True,
    SynchronousSolve=True)
panel_4 = Panel(hops_2)
panel_5 = Panel(hops_3)
panel_6 = Panel(hops_4)
panel_7 = Panel(hops_7)
panel_8 = Panel(hops_8)
panel_9 = Panel(hops_6)
panel_10 = Panel(hops_5)
panel_11 = Panel(hops_9)
